# Grasshopper definition ass3 UM geojson.gh (Grasshopper 1.0.4)
# Copyright: Co-de-iT

slider = Slider(0.775, range=0..1)
slider_2 = Slider(415, range=0..1000)
slider_3 = Slider(4, range=0..10)
slider_4 = Slider(3.448, range=0..10)
türachse = Point([<point referenced from the Rhino model> x37])
stiegenhaus = Curve([<curve referenced from the Rhino model> x17])
gebäudegrundriss = Curve([<curve referenced from the Rhino model> x38])
lng = ListLength(List=türachse)
dom = ConstructDomain(DomainStart=Slider(2.171, range=0..5), DomainEnd=Slider(9.176, range=0..10))
drec = DeconstuctRectangle(Rectangle=stiegenhaus)  # -> BasePlane, XInterval, YInterval
deplane = DeconstructPlane(Plane=drec.BasePlane)  # -> Origin, XAxis, YAxis, ZAxis
addition = Addition(A=slider_3, B=slider)
dom_2 = ConstructDomain(DomainStart=Slider(50, range=0..1000), DomainEnd=slider_2)
lng_2 = ListLength(List=gebäudegrundriss)
random = Random(Range=dom, Number=lng, Seed=2)
partition = PartitionList(List=gebäudegrundriss, Size=1)
multiplication = Multiplication(A=slider_2, B=addition)
dedom2num = DeconstructDomain²(Domain=drec.XInterval)  # -> UMin, UMax, VMin, VMax
dedom2num_2 = DeconstructDomain²(Domain=drec.YInterval)  # -> UMin, UMax, VMin, VMax
multiplication_2 = Multiplication(A=dedom2num_2.UMax, B=deplane.YAxis)
dedom2num_3 = DeconstructDomain²(Domain=drec.XInterval)  # -> UMin, UMax, VMin, VMax
dedom2num_4 = DeconstructDomain²(Domain=drec.XInterval)  # -> UMin, UMax, VMin, VMax
cir = Circle(Plane=türachse, Radius=random)
addition_2 = Addition(A=slider, B=Slider(5.088, range=0..10))
dom_3 = ConstructDomain(DomainStart=Slider(2.778, range=0..5), DomainEnd=slider_4)
random_2 = Random(Range=dom_2, Number=lng_2, Seed=2, Integers=True)
Z = UnitZ(Factor=multiplication)
Z_2 = UnitZ(Factor=slider)
ccx = CurveCurve(CurveA=partition, CurveB=cir)  # -> Points, ParamsA, ParamsB
Z_3 = UnitZ(Factor=addition_2)
move = Move(Geometry=deplane.Origin, Motion=multiplication_2)  # -> Geometry, Transform
multiplication_3 = Multiplication(A=dedom2num.UMax, B=deplane.XAxis)
multiplication_4 = Multiplication(A=dedom2num_3.UMax, B=0.5)
multiplication_5 = Multiplication(A=multiplication_4, B=deplane.XAxis)
multiplication_6 = Multiplication(A=dedom2num_4.UMax, B=0.5)
multiplication_7 = Multiplication(A=multiplication_6, B=deplane.XAxis)
random_3 = Random(Range=dom_3, Number=lng_2, Seed=2)  # -> graft(Random)
extr = Extrude(Base=stiegenhaus, Direction=Z)
move_2 = Move(Geometry=ccx.Points, Motion=Z_3)  # -> Geometry, Transform
Z_4 = UnitZ(Factor=slider)
move_3 = Move(Geometry=deplane.Origin, Motion=multiplication_3)  # -> Geometry, Transform
move_4 = Move(Geometry=move.Geometry, Motion=multiplication_3)  # -> Geometry, Transform
move_5 = Move(Geometry=deplane.Origin, Motion=multiplication_5)  # -> Geometry, Transform
move_6 = Move(Geometry=move.Geometry, Motion=multiplication_7)  # -> Geometry, Transform
Z_5 = UnitZ(Factor=slider)
ln = Line(StartPoint=ccx.Points, EndPoint=move_2.Geometry)
move_7 = Move(Geometry=extr, Motion=Z_2)  # -> Geometry, Transform
neg = Negative(Value=random_3)
subtraction = Subtraction(A=slider_3, B=slider)
pt = Point(deplane.Origin)
pt_2 = Point(move_3.Geometry)
pt_3 = Point(move_4.Geometry)
pt_4 = Point(move.Geometry)
pt_5 = Point(move_5.Geometry)
pt_6 = Point(move_6.Geometry)
loft = Loft(Curves=ln, Options={Adjust=False, Closed=False, LoftEnds=0, LoftSimp=0, LoftType=0, Rebuild=10, Refit=0.01})
neg_2 = Negative(Value=slider_4)
extr_2 = Extrude(Base=gebäudegrundriss, Direction=Z_5)
multiplication_8 = Multiplication(A=random_2, B=slider_3)
Z_6 = UnitZ(Factor=slider_3)
arrlinear = LinearArray(Geometry=gebäudegrundriss, Direction=Z_6, Count=random_2)  # -> Geometry, Transform
move_8 = Move(Geometry=arrlinear.Geometry, Motion=Z_4)  # -> Geometry, Transform
partition_2 = PartitionList(List=move_7.Geometry, Size=expr("1", [3, 2]))
Z_7 = UnitZ(Factor=subtraction)
multiplication_9 = Multiplication(A=slider_3, B=2)
multiplication_10 = Multiplication(A=slider_3, B=2)
offset = Offset(Curve=move_8.Geometry, Distance=neg, Plane=PlaneXY(0, 0, 0), Corners=1)
addition_3 = Addition(A=slider, B=multiplication_9)
addition_4 = Addition(A=slider, B=slider_3)
addition_5 = Addition(A=slider, B=slider_3)
addition_6 = Addition(A=slider, B=multiplication_10)
addition_7 = Addition(A=slider, B=slider_3)
offset_2 = Offset(Surface=loft, Distance=[slider_4, neg_2], Retrim=True)
debrep = DeconstructBrep(Brep=offset_2)  # -> Faces, flatten(Edges), Vertices
cap = CapHoles(Brep=extr_2)
Z_8 = UnitZ(Factor=multiplication_8)
multiplication_11 = Multiplication(A=addition_3, B=deplane.ZAxis)
multiplication_12 = Multiplication(A=slider, B=deplane.ZAxis)
multiplication_13 = Multiplication(A=addition_4, B=deplane.ZAxis)
multiplication_14 = Multiplication(A=addition_5, B=deplane.ZAxis)
multiplication_15 = Multiplication(A=addition_6, B=deplane.ZAxis)
multiplication_16 = Multiplication(A=addition_7, B=deplane.ZAxis)
multiplication_17 = Multiplication(A=slider, B=deplane.ZAxis)
join = JoinCurves(Curves=debrep.Edges, Preserve=False)
partition_3 = PartitionList(List=join, Size=2)
arrlinear_2 = LinearArray(Geometry=cap, Direction=Z_6, Count=random_2)  # -> Geometry, Transform
extr_3 = Extrude(Base=offset, Direction=Z_7)
move_9 = Move(Geometry=pt, Motion=multiplication_11)  # -> Geometry, Transform
move_10 = Move(Geometry=pt_2, Motion=multiplication_12)  # -> Geometry, Transform
move_11 = Move(Geometry=pt_3, Motion=multiplication_13)  # -> Geometry, Transform
move_12 = Move(Geometry=pt_4, Motion=multiplication_14)  # -> Geometry, Transform
move_13 = Move(Geometry=pt_5, Motion=multiplication_15)  # -> Geometry, Transform
move_14 = Move(Geometry=pt_6, Motion=multiplication_16)  # -> Geometry, Transform
move_15 = Move(Geometry=pt_5, Motion=multiplication_17)  # -> Geometry, Transform
loft_2 = Loft(Curves=partition_3, Options={Adjust=False, Closed=False, LoftEnds=0, LoftSimp=0, LoftType=5, Rebuild=10, Refit=0.01})
cap_2 = CapHoles(Brep=loft_2)  # -> flatten(Brep)
srf4pt = _4PointSurface(CornerA=move_9.Geometry, CornerB=move_13.Geometry, CornerC=move_14.Geometry, CornerD=move_12.Geometry)
srf4pt_2 = _4PointSurface(CornerA=move_10.Geometry, CornerB=move_15.Geometry, CornerC=move_14.Geometry, CornerD=move_11.Geometry)
multiplication_18 = Multiplication(A=slider_3, B=2)
subtraction_2 = Subtraction(A=random_2, B=2)
subtraction_3 = Subtraction(A=random_2, B=1)
Z_9 = UnitZ(Factor=multiplication_18)
multiplication_19 = Multiplication(A=subtraction_2, B=0.5)
multiplication_20 = Multiplication(A=subtraction_3, B=0.5)
move_16 = Move(Geometry=cap, Motion=Z_8)  # -> Geometry, Transform
sint = SolidIntersection(BrepsA=arrlinear_2.Geometry, BrepsB=partition_2)
arrlinear_3 = LinearArray(Geometry=srf4pt, Direction=Z_9, Count=multiplication_19)  # -> Geometry, Transform
arrlinear_4 = LinearArray(Geometry=srf4pt_2, Direction=Z_9, Count=multiplication_20)  # -> Geometry, Transform
trim = TrimSolid(Shape=extr_3, Cutters=cap_2)
cap_3 = CapHoles(Brep=move_16.Geometry)
brep = Brep([cap_3, sint, arrlinear_3.Geometry, arrlinear_4.Geometry, trim])
panel = Panel("""{
  "type": "FeatureCollection",
  "features": [
    {
      "type": "Feature",
      "properties": {},
      "geometry": {
        "type": "LineString",
        "coordinates": [
          [
            141.44970417022705,
            -31.97269701561497
          ],
          [
            141.4524507522583,
            -31.97062190095427
          ],
          [
            141.45442485809326,
            -31.96785500843591
          ],
          [
            141.45678520202637,
            -31.965306481024417
          ],
          [
            141.46214962005612,
            -31.961811242684117
          ],
          [
            141.47313594818115,
            -31.955876314531935
          ],
          [
            141.4764404296875,
            -31.95467471797777
          ],
          [
            141.48056030273435,
            -31.957660474355514
          ],
          [
            141.47360801696777,
            -31.963449652222046
          ],
          [
            141.47249221801758,
            -31.966435123319695
          ],
          [
            141.46931648254395,
            -31.96894721281321
          ],
          [
            141.47034645080566,
            -31.970112216493302
          ],
          [
            141.46845817565918,
            -31.971350016703767
          ],
          [
            141.47021770477295,
            -31.9732794955086
          ],
          [
            141.45910263061523,
            -31.98139742423382
          ],
          [
            141.4562702178955,
            -31.978303231159245
          ],
          [
            141.45429611206055,
            -31.977465960980613
          ],
          [
            141.4532232284546,
            -31.976810700729875
          ],
          [
            141.45275115966797,
            -31.975500166192926
          ],
          [
            141.45215034484863,
            -31.975500166192926
          ]
        ]
      }
    },
    {
      "type": "Feature",
      "properties": {},
      "geometry": {
        "type": "LineString",
        "coordinates": [
          [
            141.45215034484863,
            -31.975427358169952
          ],
          [
            141.4496612548828,
            -31.97262420536837
          ]
        ]
      }
    }
  ]
}""")
jsonpoly_1_1 = GeoJSONToPolyline11(J=panel)  # -> doc_2, P_2, K_3, V_3
deextrusion_1_1 = DeconstructExtrusion11(brep=brep)  # -> doc_2, G, bh_3, bh_4
panel_2 = Panel("""height
base_height
colour""")
crv = Curve(jsonpoly_1_1.P_2)
entwine = Entwine(Branch00=deextrusion_1_1.bh_3, Branch01=deextrusion_1_1.bh_4, Branch02="#AAAAAA", FlattenInputs=True)
polyjson_1_1 = PolygonToGeoJSON11(P=deextrusion_1_1.G, K=panel_2, V=entwine)  # -> doc_2, J_2
file_write = FileWrite(content=polyjson_1_1.J_2, file_path="C:\Users\james\Desktop\Assignment 3", T="test2.geojson", activate=Toggle(False))

# ==== cluster GeoJSONToPolyline11: Converts GeoJSON into Grasshopper geometry.
J = ClusterInput()
J_2 = Text(J)
rep = ReplaceText(Text=J_2, Find=" ", RecursiveReplace=False)
python = PythonScript(json_string=rep)  # -> doc, polylines, key, value, xyzList, coordList
# ---------- python: Python ----------
doc = """Split featureJSON into features
more exlantion here
HELLO!!!
"""
import json
import rhinoscriptsyntax as rs
import Rhino.Geometry as rg
appendPolyline = []

def main():
    raw_json = json.loads(json_string)
    features_list = raw_json["features"]
    propertieslist = [] 
    valuelist = []
    coordList =[]
    
    for item in features_list:
        coordinates = item['geometry']['coordinates']
        coordList.append(str(coordinates))
        try:#properties
            item['properties']
            properties=item['properties']
            propertieslist.append(properties)
            value = []
            for prop in properties:
                item_value = item['properties'][prop]
                value.append(item_value)
            valuelist.append(value)
        except KeyError: 
            properties = "<null>"
            propertieslist.append(properties)
    return {
            "coordList":coordList,
            "key":propertieslist,
            "value":valuelist,
            }
results = main()
coordList = results["coordList"]
key = results["key"]
value = results["value"]
#colour= results["colour"]
#polylines = results["polylines"]
#brep = results["brep"]
# ---------- end python ----------
python_2 = PythonScript(x=python.key)  # -> simplify(a)
# ---------- python_2: Python ----------
a=x
# ---------- end python_2 ----------
python_3 = PythonScript(x=python.value)  # -> simplify(a); same code as python_2
panel = Panel("""OUTPUTS:

Polyline Curve (P)- Closed Polyline.

Keys (K) - Outputs keys found in properties

Values (V) - Outputs values found in properties""")
panel_2 = Panel(""" 
INPUTS: 

GeoJSON (J) - FeatureCollection containing geoemtry type objects.
*Only accepts easting, northing (N,E) coordinates.
 """)
panel_3 = Panel("For more documentation visit: github.com/madeleinejohanson/Humpback")
lng = ListLength(List=python.coordList)

# ---- group: List of coordinates
data = Data(python.coordList)

# ----
equals = Equality(FirstNumber=lng, SecondNumber=1)  # -> Equality, Inequality
rep_2 = ReplaceText(Text=data, Find=" ", RecursiveReplace=False)
gate = StreamGate(Gate=0)  # -> Target0, Target1
split = TextSplit(Text=rep_2, Separators=",")  # -> simplify(Result)
merge = Merge(
    Data1="GEOJSON TO POLYGON",
    Data2="Converts GeoJSON into Grasshopper geometry.",
    Data3=panel_2,
    Data4=panel,
    Data5=panel_3)
doc = Text(merge)

cull_i = CullIndex(List=split, Indices=0, Wrap=True)
cull_i_2 = CullIndex(List=cull_i, Indices=-1, Wrap=True)

doc_2 = ClusterOutput(doc)
dispatch = Dispatch(List=cull_i_2, DispatchPattern=[False, True])  # -> simplify(ListA), ListB
chars = Characters(Text=dispatch.ListA)  # -> Result, Unicode
mindex = MemberIndex(Set=chars.Result, Member="[")  # -> Index, Count
equals_2 = Equality(FirstNumber=mindex.Count, SecondNumber=2)  # -> simplify(Equality), Inequality
trim = TrimTree(Tree=equals_2.Equality, Depth=1)
ma = MassAddition(Input=trim)  # -> Result, PartialResults
dispatch_2 = Dispatch(List=dispatch.ListA, DispatchPattern=trim)  # -> ListA, ListB
larger = LargerThan(FirstNumber=flatten(ma.Result), SecondNumber=0)  # -> LargerThan, OrEqualTo
viewer = ParamViewer(ma.Result)
index = ItemIndex(List=split, Item=dispatch_2.ListA)  # -> simplify(Index)
clean = CleanTree(RemoveNulls=True, RemoveInvalid=True, RemoveEmpty=True, Tree=index)
short = ShortestList(ListA=Slider(0, range=0..100), ListB=clean, TrimMode=2)  # -> ListA, ListB
dispatch_3 = Dispatch(List=viewer, DispatchPattern=larger.LargerThan)  # -> ListA, ListB
branch = TreeBranch(Tree=split, Path=dispatch_3.ListA, MaintainPaths=True)
branch_2 = TreeBranch(Tree=split, Path=dispatch_3.ListB, MaintainPaths=True)  # -> simplify(Branch)
lng_2 = ListLength(List=branch)
merge_2 = Merge(Data1=short.ListA, Data2=index, Data3=lng_2)
cull_i_3 = CullIndex(List=merge_2, Indices=-1, Wrap=True)
shift = ShiftList(List=merge_2, Shift=1, Wrap=False)
path_mapper = PathMapper(branch_2, source="{A}", target="{A;0}")
subtraction = Subtraction(A=shift, B=cull_i_3)
partition = PartitionList(List=split, Size=subtraction)  # -> simplify(Chunks)
merge_3 = Merge(Data1=path_mapper, Data2=partition)
filter = StreamFilter(Gate=equals.Equality, Stream0=merge_3, Stream1=split)
rep_3 = ReplaceText(Text=filter, Find="[", RecursiveReplace=False)
rep_4 = ReplaceText(Text=rep_3, Find="]", RecursiveReplace=False)
dispatch_4 = Dispatch(List=rep_4, DispatchPattern=[True, False])  # -> ListA, ListB
number_slider = Slider(100000, range=0..100000)
K = Text(simplify(python_2))
V = Data(simplify(python_3))
multiplication = Multiplication(A=dispatch_4.ListB, B=number_slider)
multiplication_2 = Multiplication(A=dispatch_4.ListA, B=number_slider)
pt = ConstructPoint(XCoordinate=multiplication_2, YCoordinate=multiplication, ZCoordinate=0)
lng_3 = ListLength(List=pt)
join = TextJoin(Text=K, Join="█")
join_2 = TextJoin(Text=V, Join="█")
larger_2 = LargerThan(FirstNumber=lng_3, SecondNumber=2)  # -> LargerThan, OrEqualTo
pline = PolyLine(Vertices=pt, Closed=larger_2.LargerThan)
crv = Curve(pline)
P = Curve(simplify(crv))
utrim = UberTrim(data=P, bool=False)
lng_4 = ListLength(List=utrim)
repeat = RepeatData(Data=join, Length=lng_4)
repeat_2 = RepeatData(Data=join_2, Length=lng_4)
split_2 = TextSplit(Text=repeat, Separators="█")  # -> simplify(Result)
split_3 = TextSplit(Text=repeat_2, Separators="█")  # -> simplify(Result)
P_2 = ClusterOutput(P)
K_2 = Text(simplify(split_2))
V_2 = Data(simplify(split_3))
K_3 = ClusterOutput(K_2)
V_3 = ClusterOutput(V_2)

# ==== cluster DeconstructExtrusion11: Deconstructs simple extrusions into polylines, heights, and base heights for later use in ‘Polygon to GeoJSON component’.
brep = ClusterInput()
brep_2 = Brep(simplify(graft(brep)))
cap = CapHoles(Brep=brep_2)
mesh = MeshBrep(
    Brep=cap,
    Settings={GridMaxCount=0, GridMinCount=16, JaggedSeams=False, MaxEdgeLength=0, MinEdgeLength=0.0001, MinTolerance=0, Refine=True, RefineAngle=0, RelativeTolerance=0.65, SimplePlanes=True, Tolerance=0})
mshadow = MeshShadow(Mesh=mesh, Light=Vector(0, 0, -1), Plane=PlaneXY(0, 0, 0))
demesh = DeconstructMesh(Mesh=mesh)  # -> Vertices, Faces, Colours, Normals
pdecon = Deconstruct(Point=demesh.Vertices)  # -> XComponent, YComponent, ZComponent
panel = Panel("Deconstructs simple extrusions into polylines, heights, and base heights for later use in ‘Polygon to GeoJSON component’.")
panel_2 = Panel(""" 
INPUTS: 

Brep (B) - Extruded or capped Breps. Must be extruded in the z axis. """)
panel_3 = Panel("""OUTPUTS:

Polyline (Crv)- Projected base polyline of Brep.

Height (H) - Height of Brep.The distance of extrusion. 

Base Height (BH) - The height of the base of the brep from the ground XY Plane.""")
sort = SortList(Keys=pdecon.ZComponent)  # -> Keys, ValuesA
item = ListItem(List=sort.Keys, Index=0, Wrap=True)  # -> Item1, Item
panel_4 = Panel("For more documentation visit: github.com/madeleinejohanson/Humpback")
subtraction = Subtraction(A=item.Item1, B=item.Item)
bh = Data(simplify(flatten(subtraction)))
bh_2 = Data(simplify(flatten(item.Item)))
Z = UnitZ(Factor=bh_2)
merge = Merge(Data1="DECONSTRUCT EXTRUSION", Data2=panel, Data3=panel_2, Data4=panel_3, Data5=panel_4)
move = Move(Geometry=flatten(mshadow), Motion=Z)  # -> Geometry, Transform
doc = Text(merge)
doc_2 = ClusterOutput(doc)
panel_5 = Panel(doc)

# ---- group: Cluster Output
bh_3 = ClusterOutput(bh)

# ----
bh_4 = ClusterOutput(bh_2)
G = ClusterOutput(move.Geometry)

# ==== cluster PolygonToGeoJSON11: Writes a polygon to a GeoJSON file, where keys and values can be defined.
P = ClusterInput()
P_2 = Curve(P)
cp = ControlPoints(Curve=P_2)  # -> simplify(Points), Weights, Knots
V = ClusterInput()
K = ClusterInput()
V_2 = Data(simplify(V))
points_to_coordinates = PointsToCoordinates(P=cp.Points)
K_2 = Text(simplify(K))
clean = CleanTree(RemoveNulls=True, RemoveInvalid=True, RemoveEmpty=True, Tree=V_2)
viewer = ParamViewer(clean)
flip = FlipMatrix(Data=clean)
graft = GraftTree(Tree=K_2, IncludeEmptyLists=True, IncludeNullItems=True)  # -> simplify(Tree)
viewer_2 = ParamViewer(graft)
short = ShortestList(ListA=viewer_2, ListB=viewer, TrimMode=2)  # -> ListA, ListB
lng = ListLength(List=flatten(short.ListB))
series = Series(Start=0, Step=1, Count=lng)
item = ListItem(List=viewer_2, Index=series, Wrap=False)
flip_2 = FlipMatrix(Data=flip)
branch = TreeBranch(Tree=graft, Path=item, MaintainPaths=True)
clean_2 = CleanTree(RemoveNulls=True, RemoveInvalid=True, RemoveEmpty=True, Tree=branch)
flatten = FlattenTree(Tree=clean_2, Path="{0}")
rep = ReplaceText(Text="\"█\"", Find="█", Replace=flatten, RecursiveReplace=False)  # -> flatten(Result)
series_2 = Series(Start=0, Step=1, Count=lng)
mindex = MemberIndex(Set=rep, Member="\"height\"")  # -> Index, Count
rep_2 = ReplaceText(Text="{ \"type\": \"Polygon\",█}", Find="█", Replace=points_to_coordinates, RecursiveReplace=False)

# ---- group: Polygon
flatten_2 = FlattenTree(Tree=rep_2, Path="{0}")

# ----
mindex_2 = MemberIndex(Set=rep, Member="\"base_height\"")  # -> Index, Count
panel = Panel("Writes a polygon to a GeoJSON file, where keys and values can be defined. ")
panel_2 = Panel("""OUTPUTS:

GeoJSON (J) - Produces a GeoJSON Feature Collection.""")
panel_3 = Panel(""" 
INPUTS: 

Polyline Curve (P) - Polygon or list of polygons to convert to GeoJSON.

Key (K)- Properties used to describe geometry. To specify height, base height and colour, use the following keys: 

height
base_height
colour 

Value (V) - Values of properties. The list should be structured so that the first branch of data is associated with the first key. This allows unique values to be associated with multiple polygons. """)
panel_4 = Panel("For more documentation visit: github.com/madeleinejohanson/Humpback")
rep_3 = ReplaceText(Text="{\"type\":\"Feature\",\"geometry\":█", Find="█", Replace=flatten_2, RecursiveReplace=False)
merge = Merge(Data1="POLYGON TO GEOJSON", Data2=panel, Data3=panel_3, Data6=panel_2, Data7=panel_4)
doc = Text(merge)
doc_2 = ClusterOutput(doc)
panel_5 = Panel(doc)

# ---- group: Keeps lists consistent lengths, repeating the last value for the total amount of keys
null = NullItem(Item=flip)  # -> NullFlags, InvalidFlags, Description
dispatch = Dispatch(List=flip, DispatchPattern=null.NullFlags)  # -> ListA, ListB
nullrep = ReplaceNulls(Items=flip, Replacements="█")  # -> Items, Count
index = ItemIndex(List=dispatch.ListB, Item=dispatch.ListB)
item_2 = ListItem(List=flip, Index=index, Wrap=True)
mindex_3 = MemberIndex(Set=nullrep.Items, Member="█")  # -> Index, Count
flip_3 = FlipMatrix(Data=item_2)
clean_3 = CleanTree(RemoveNulls=True, RemoveInvalid=True, RemoveEmpty=False, Tree=flip_3)
item_3 = ListItem(List=clean_3, Index=0, Wrap=True)  # -> flatten(Item1), Item

# ----
merge_2 = Merge(Data1=flip_3, Data2=flip_2)
clean_4 = CleanTree(RemoveNulls=True, RemoveInvalid=True, RemoveEmpty=False, Tree=merge_2)
item_4 = ListItem(List=clean_4, Index=0, Wrap=True)  # -> flatten(Item1), Item

# ---- group: Keeps lists consistent lengths, repeating the last value for the total amount of keys (continued)
item_5 = ListItem(List=item_4.Item1, Index=mindex_3.Index, Wrap=True)
replace = ReplaceItems(List=nullrep.Items, Item=item_5, Indices=mindex_3.Index, Wrap=False)

# ----
flip_4 = FlipMatrix(Data=replace)
viewer_3 = ParamViewer(flip_4)
item_6 = ListItem(List=viewer_3, Index=series_2, Wrap=True)

# ---- group: Keeps lists consistent lengths, repeating the last value for the total amount of keys (continued)
branch_2 = TreeBranch(Tree=flip_4, Path=item_6, MaintainPaths=True)  # -> simplify(Branch)

# ----
flip_5 = FlipMatrix(Data=branch_2)

# ---- group: height
item_7 = ListItem(List=flip_5, Index=mindex.Index, Wrap=True)

# ---- group: base_height
item_8 = ListItem(List=flip_5, Index=mindex_2.Index, Wrap=True)

# ----
addition = Addition(A=item_7, B=item_8)
replace_2 = ReplaceItems(List=simplify(flip_5), Item=addition, Indices=mindex.Index, Wrap=False)  # -> simplify(List)
clean_5 = CleanTree(RemoveNulls=True, RemoveInvalid=True, RemoveEmpty=True, Tree=replace_2)
key_value = KeyValue(K=clean_2, V=clean_5)
rep_4 = ReplaceText(Text=",\"properties\":█}", Find="█", Replace=key_value, RecursiveReplace=False)

# ---- group: Feature
concat = Concatenate(FragmentA=rep_3, FragmentB=rep_4)  # -> flatten(Result)

# ----
join = TextJoin(Text=concat, Join=",")
panel_6 = Panel(key_value)
rep_5 = ReplaceText(Text="{\"type\":\"FeatureCollection\",\"features\":[█]}", Find="█", Replace=join, RecursiveReplace=False)
J = Text(rep_5)
J_2 = ClusterOutput(J)

# ==== cluster FileWrite: Exports text to file
content = ClusterInput()
file_path = ClusterInput()
activate = ClusterInput()
T = ClusterInput()
content_2 = Data(content)
file_path_2 = Text(file_path)
join = TextJoin(Text=[file_path_2, T], Join="\")
vb = VBScript(path=simplify(join), lines=simplify(content_2), activate=activate)  # -> out, A
# ---------- vb: VB ----------
    If (activate = True)
      
      system.IO.File.WriteAllText(path, lines)
      A = "File written"
    Else
      A = "Not activated"
    End If
# ---------- end vb ----------

# ==== cluster UberTrim: Better version of Trim
data = ClusterInput()
bool = ClusterInput()
data_2 = Data(data)
trim = TrimTree(Tree=data_2, Depth=1)
null = NullItem(Item=trim)  # -> NullFlags, InvalidFlags, Description
dispatch = Dispatch(List=data_2, DispatchPattern=null.NullFlags)  # -> ListA, ListB
bool_2 = Boolean(bool)
trim_2 = TrimTree(Tree=dispatch.ListB, Depth=1)
bool_3 = Boolean(invert(null.NullFlags))
flatten = FlattenTree(Tree=dispatch.ListA, Path="{0}")
merge = Merge(Data1=flatten, Data2=trim_2)
panel = Panel(null.NullFlags)
trim_3 = TrimTree(Tree=data_2, Depth=bool_3)
bool_4 = Boolean(invert(bool_2))
data_3 = Data(trim_3)
dispatch_2 = Dispatch(List=merge, DispatchPattern=bool_4)  # -> ListA, ListB
dispatch_3 = Dispatch(List=data_3, DispatchPattern=bool_2)  # -> ListA, ListB
clean = CleanTree(RemoveNulls=True, RemoveInvalid=True, RemoveEmpty=True, Tree=dispatch_3.ListB)
clean_2 = CleanTree(RemoveNulls=True, RemoveInvalid=True, RemoveEmpty=True, Tree=dispatch_2.ListB)
merge_2 = Merge(Data1=clean, Data2=clean_2)
R = ClusterOutput(merge_2)
panel_2 = Panel(merge_2)

# ==== cluster PointsToCoordinates
P = ClusterInput()
number_slider = Slider(100042, range=0..1000000)
pt2num = PointsToNumbers(Points=graft(P), Mask=4)
number_slider_2 = Slider(1000404, range=0..10000000)
division = Division(A=pt2num, B=Slider(100000, range=0..100000))
expression = Expression(x=division, Expression="format(\"{0}\",x)")
int = Integer(99960)
item = ListItem(List=expression, Index=0, Wrap=True)  # -> Item, Item1, Item2
panel = Panel(pt2num)
num = Number(item.Item2)  # disabled
merge = Merge(Data1=item.Item, Data2=item.Item1, Data3=num)
panel_2 = Panel(division)
wrapper = Wrapper(wrap="[", content=merge, join=",")  # -> simplify(wrapped)
utrim = UberTrim(data=wrapper, bool=Toggle(True))
wrapper_2 = Wrapper(wrap="[", content=utrim, join=",")
rep = ReplaceText(Text="\"coordinates\": [█]", Find="█", Replace=wrapper_2, RecursiveReplace=False)  # -> simplify(Result)
R = ClusterOutput(rep)

# ==== cluster KeyValue
K = ClusterInput()
V = ClusterInput()
K_2 = Text(simplify(K))
V_2 = Data(simplify(V))

# ---- group: HUMPBACK 1.1 Treats numbers as numbers instead of strings
int = Integer(V_2)
null = NullItem(Item=int)  # -> NullFlags, InvalidFlags, Description
panel = Panel("""█
"█"
""")
item = ListItem(List=panel, Index=null.NullFlags, Wrap=True)
rep = ReplaceText(Text=item, Find="█", Replace=V_2, RecursiveReplace=False)

# ----
panel_2 = Panel(K_2)
rep_2 = ReplaceText(Text="\"█\"", Find="█", Replace=K_2, RecursiveReplace=False)  # -> simplify(Result)
panel_3 = Panel("\"█\"")  # disabled
panel_4 = Panel("█")  # disabled
rep_3 = ReplaceText(Text=panel_3, Find=panel_4, Replace=V_2, RecursiveReplace=False)  # disabled
flip = FlipMatrix(Data=rep)  # -> simplify(Data)
lng = ListLength(List=flatten(rep_2))
viewer = ParamViewer(flip)
series = Series(Start=0, Step=1, Count=lng)
item_2 = ListItem(List=viewer, Index=series, Wrap=True)
branch = TreeBranch(Tree=simplify(flip), Path=simplify(item_2), MaintainPaths=True)
long = LongestList(ListA=rep_2, ListB=branch, PaddingMode=2)  # -> ListA, ListB
merge = Merge(Data1=graft(long.ListA), Data2=graft(long.ListB))
join = TextJoin(Text=merge, Join=":")
trim = TrimTree(Tree=join, Depth=1)
flip_2 = FlipMatrix(Data=trim)
join_2 = TextJoin(Text=flip_2, Join=",")
rep_4 = ReplaceText(Text="{█}", Find="█", Replace=join_2, RecursiveReplace=False)  # -> flatten(Result)
J = Text(rep_4)
J_2 = ClusterOutput(J)

# ==== cluster Wrapper: Wraps data with a wrapping character
join = ClusterInput()  # Join character
content = ClusterInput()  # Content to be wrapped
wrap = ClusterInput()  # Wrap character or XML tag
txt = Text(join)
null = NullItem(Item=txt)  # -> NullFlags, InvalidFlags, Description
data = Data(content)
tmatch = MatchText(Text=wrap, RegEx="<*.>", Case=True)
bool = Boolean(null.NullFlags)
dispatch = Dispatch(List=data, DispatchPattern=bool)  # -> ListA, ListB
item = ListItem(List=wrap, Index=0, Wrap=True)
split = TextSplit(Text=item, Separators=" ")
join_2 = TextJoin(Text=dispatch.ListB, Join=txt)
panel = Panel("""{
[
(
"
'""")
panel_2 = Panel("""{█}
[█]
(█)
"█"
'█'""")
item_2 = ListItem(List=split, Index=0, Wrap=True)
weave = Weave(Pattern=bool, Stream0=join_2, Stream1=dispatch.ListA, NullGaps=False)
data_2 = Data(wrap)
replace = ReplaceMembers(Set=data_2, Find=panel, Replace=panel_2)
rep = ReplaceText(Text=item_2, Find="<", Replace="</", RecursiveReplace=False)
expression = Expression(x=item, y=rep, Expression="Format(\"{0}█{1}>\", x, y)")
rep_2 = ReplaceText(Text=expression, Find=">>", Replace=">", RecursiveReplace=False)
weave_2 = Weave(Pattern=tmatch, Stream0=replace, Stream1=rep_2, NullGaps=False)
rep_3 = ReplaceText(Text=weave_2, Find="█", Replace=weave, RecursiveReplace=False)
data_3 = Data(rep_3)
wrapped = ClusterOutput(data_3)  # Wrapped Output
